# Grasshopper definition kirigami facade.gh (Grasshopper 1.0.7)
# plug-ins: Ironbug.LBHB_Legacy

# ---- group: ファサードパラメータ
number_slider = Slider(4, range=1..5)
x_mm_中心部_2x = Slider(100, range=0..500)
y_mm_幅 = Slider(80, range=0..500)
z_mm_連結部_2z = Slider(50, range=0..500)
h_mm_高さ = Slider(469, range=0..1000)
t_mm_厚さ = Slider(30, range=0..100)

# ---- group: ファサード / n=1 / O1
negative = Negative(Value=x_mm_中心部_2x)
multiplication = Multiplication(A=x_mm_中心部_2x, B="2")
unit_x = UnitX(Factor=negative)
unit_y = UnitY(Factor=negative)
rectangle = Rectangle(Plane=PlaneXY(0, 0, 0), XSize=multiplication, YSize=multiplication, Radius=0)  # -> Rectangle, Length
move = Move(Geometry=rectangle.Rectangle, Motion=unit_x)  # -> Geometry, Transform
move_2 = Move(Geometry=move.Geometry, Motion=unit_y)  # -> Geometry, Transform
boundary_surfaces = BoundarySurfaces(Edges=move_2.Geometry)

# ---- group: 構造解析 / 構造解析パラメータ
p_g_cm_2_平坦部密度 = Slider(2.706, range=0..3)
q_g_cm_2_湾曲部密度 = Slider(2.052, range=0..3)
g_m_s_2_重力加速度 = Slider(9.8, range=0..10)

# ---- group: 光環境解析パラメータ
honeybee = Honeybee_Honeybee()  # -> Vviiiiiiiiiizzz; plug-in component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
ladybug = Ladybug_Ladybug()  # -> Vviiiiiiiiiizzz; plug-in component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

# ---- group: 光環境解析パラメータ / 解析開始
結果書き込み = BooleanToggle(True)
解析開始 = BooleanToggle(True)
作業フォルダ = FilePath("C:\Users\10mot\Desktop\DaylightAnalysis\DaylightAnalysis\")

# ---- group: 光環境解析パラメータ / 部屋
天井 = Brep(<brep referenced from the Rhino model>)
ガラス = Brep(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)
ファサード反射率 = Panel(".35")
壁 = Brep([<brep referenced from the Rhino model> x4])
床 = Brep(<brep referenced from the Rhino model>)
家具 = Brep(<brep referenced from the Rhino model>)
ファサードマテリアル = Panel("generic_35")
ガラスマテリアル = Panel("glass_.65")
ガラス透過率 = Panel(".65")

# ---- group: 光環境解析パラメータ / 気象環境
epw = FilePath("C:\Users\10mot\Desktop\DaylightAnalysis\DaylightAnalysis\tokyo.epw")
月 = Slider(8, range=1..12)
日 = Slider(21, range=1..31)
時 = Slider(12, range=0..24)
北方向 = Slider(10, range=0..100)
空模様 = Slider(0, range=0..5)

# ---- group: 光環境解析6-4.ver / 気象環境設定
表示倍率 = Panel(".01")
genstandardciesky = Honeybee_GenerateStandardCIESky(north=北方向, weatherFile=epw, month=月, day=日, hour=時, skyType=空模様)  # -> skyFilePath; plug-in component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
northarrow = Ladybug_North(north=北方向, scale=表示倍率)  # -> northSign; plug-in component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

# ---- group: 光環境解析6-4.ver / 解析環境設定
set_the_view_to_fisheye_for_glare_analys = Panel("1")  # "set the view to FishEye for Glare Analysis"
質 = Slider(0, range=0..2)
radparameters = Honeybee_RADParameters(quality=質)  # -> readMe, radParameters; plug-in component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
imagebasedsimulation = Honeybee_ImageBasedSimulation(
    skyFile=genstandardciesky,
    cameraType=set_the_view_to_fisheye_for_glare_analys,
    simulationType=2,
    radParameters=radparameters.radParameters,
    backupImages=0)  # -> analysisRecipe; plug-in component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

# ---- group: ファサード / Extrude
unit_z = UnitZ(Factor=t_mm_厚さ)
unit_z_2 = UnitZ(Factor=t_mm_厚さ)
unit_z_3 = UnitZ(Factor=t_mm_厚さ)
color_mono = BooleanToggle(True)

# ---- group: ファサード / n >= 2
h = Number(h_mm_高さ)
x = Number(x_mm_中心部_2x)
y = Number(y_mm_幅)
y_2 = Number(y)
n = Number(number_slider)
subtraction = Subtraction(A=n, B="1")

# ---- group: ファサード / n >= 2 / f
series = Series(Start="1", Step="1", Count=subtraction)
multiplication_2 = Multiplication(A=series, B="2")
subtraction_2 = Subtraction(A=multiplication_2, B="1")
panel = Panel(subtraction_2)
multiplication_3 = Multiplication(A=y_2, B=subtraction_2)
multiplication_4 = Multiplication(A=y_2, B=multiplication_2)
panel_2 = Panel(multiplication_2)
addition = Addition(A=x, B=multiplication_3)
addition_2 = Addition(A=x, B=multiplication_4)
panel_3 = Panel(addition_2)

# ---- group: ファサード / n >= 2 / b
unit_y_2 = UnitY(Factor=y_2)

# ---- group: ファサード
addition_3 = Addition(A=x_mm_中心部_2x, B=y_mm_幅)
minimum = Minimum(A=addition_3, B=z_mm_連結部_2z)
unit_z_4 = UnitZ(Factor=h_mm_高さ)

# ---- group: ファサード / n >= 2 (continued)
min_z_x_y = Number(minimum)
python_script = PythonScript(x=x, y=y, z=min_z_x_y, n=n, h=h)  # -> out, height
# ---------- python_script: Python ----------
__author__ = "taiga.u"

import rhinoscriptsyntax as rs

list = []

for a in range(int(n)):

	f1 = x - z + (2*a + 1) * y
	f2 = (2*n -1) * (x-z)
	f3 = (2*(n**2) - 2*n + 1) * y

	i = h*f1 / (f2+f3)

	list.append(i)

j = list[0]
k = 0
height = [h - list[0]]

for b in range(1, int(n)):

	j += list[b] + list[b-1]
	k = h - j
	height.append(k)
# ---------- end python_script ----------
panel_4 = Panel(python_script.height)

# ---- group: ファサード / n >= 2 / f (continued)
cull_index = CullIndex(List=python_script.height, Indices=subtraction, Wrap=True)
panel_5 = Panel(cull_index)
construct_point = ConstructPoint(XCoordinate=addition, YCoordinate=addition_2, ZCoordinate=cull_index)
panel_6 = Panel(construct_point)

# ---- group: ファサード / n >= 2 / c
addition_4 = Addition(A=addition_2, B=y_2)
cull_index_2 = CullIndex(List=python_script.height, Indices="0", Wrap=True)
panel_7 = Panel(cull_index_2)
construct_point_2 = ConstructPoint(XCoordinate=addition_4, YCoordinate=addition_4, ZCoordinate=cull_index_2)
panel_8 = Panel(construct_point_2)

# ---- group: ファサード / n=1
y_3 = Number(y_mm_幅)
x_2 = Number(x_mm_中心部_2x)
min_z_x_y_2 = Number(minimum)
n_2 = Number(number_slider)
h_2 = Number(h_mm_高さ)
addition_5 = Addition(A=x_2, B=y_3)
python_script_2 = PythonScript(x=x_2, y=y_3, z=min_z_x_y_2, n=n_2, h=h_2)  # -> out, i
# ---------- python_script_2: Python ----------
__author__ = "taiga.u"

import rhinoscriptsyntax as rs

f1 = h * (x-z+y)
f2 = (2*n -1) * (x-z)
f3 = (2*(n**2) - 2*n +1) * y

i = h - f1 / (f2 + f3)
# ---------- end python_script_2 ----------

# ---- group: ファサード / n=1 / D1
unit_x_2 = UnitX(Factor=addition_5)
rectangle_2 = Rectangle(Plane=PlaneXY(0, 0, 0), XSize=y_3, YSize=y_3, Radius=0)  # -> Rectangle, Length
move_3 = Move(Geometry=rectangle_2.Rectangle, Motion=unit_x_2)  # -> Geometry, Transform
unit_y_3 = UnitY(Factor=addition_5)
move_4 = Move(Geometry=move_3.Geometry, Motion=unit_y_3)  # -> Geometry, Transform
unit_z_5 = UnitZ(Factor=python_script_2.i)
boundary_surfaces_2 = BoundarySurfaces(Edges=move_4.Geometry)
move_5 = Move(Geometry=boundary_surfaces_2, Motion=unit_z_5)  # -> Geometry, Transform
rotate = Rotate(Geometry=move_5.Geometry, Angle=degrees("90"), Plane=PlaneXY(0, 0, 0))  # -> Geometry, Transform
rotate_2 = Rotate(Geometry=rotate.Geometry, Angle=degrees("90"), Plane=PlaneXY(0, 0, 0))  # -> Geometry, Transform
rotate_3 = Rotate(Geometry=rotate_2.Geometry, Angle=degrees("90"), Plane=PlaneXY(0, 0, 0))  # -> Geometry, Transform
geometry = Geometry([rotate_3.Geometry, move_5.Geometry, rotate.Geometry, rotate_2.Geometry])

# ---- group: ファサード / n >= 2 / e
python_script_3 = PythonScript(x=x, y=y, z=min_z_x_y, n=n, h=h)  # -> out, height
# ---------- python_script_3: Python ----------
__author__ = "taiga.u"

import rhinoscriptsyntax as rs

list = []

for a in range(int(n)):

	f1 = x - z + (2*a + 1) * y
	f2 = (2*n -1) * (x-z)
	f3 = (2*(n**2) - 2*n + 1) * y

	i = h*f1 / (f2+f3)

	list.append(i)

j = 0
k = 0
height = []

for b in range(0, int(n)-1):

	j += 2 * list[b]
	k = h - j
	height.append(k)
# ---------- end python_script_3 ----------
construct_point_3 = ConstructPoint(XCoordinate=min_z_x_y, YCoordinate=addition_2, ZCoordinate=python_script_3.height)
panel_9 = Panel(construct_point_3)

# ---- group: ファサード / n >= 2 / b (continued)
move_6 = Move(Geometry=construct_point_3, Motion=unit_y_2)  # -> Geometry, Transform
panel_10 = Panel(move_6.Geometry)

# ---- group: ファサード / n=1 / A1
negative_2 = Negative(Value=addition_3)
unit_x_3 = UnitX(Factor=negative_2)
multiplication_5 = Multiplication(A="2", B=addition_3)
unit_y_4 = UnitY(Factor=negative_2)
rectangle_3 = Rectangle(Plane=PlaneXY(0, 0, 0), XSize=multiplication_5, YSize=multiplication_5, Radius=0)  # -> Rectangle, Length
move_7 = Move(Geometry=rectangle_3.Rectangle, Motion=unit_x_3)  # -> Geometry, Transform
move_8 = Move(Geometry=move_7.Geometry, Motion=unit_y_4)  # -> Geometry, Transform
boundary_surfaces_3 = BoundarySurfaces(Edges=move_8.Geometry)
solid_difference = SolidDifference(BrepsA=boundary_surfaces_3, BrepsB=boundary_surfaces)

# ---- group: ファサード / n=1 / C1
construct_point_4 = ConstructPoint(XCoordinate=min_z_x_y_2, YCoordinate=addition_5, ZCoordinate=h_2)
unit_x_4 = UnitX(Factor=1)
construct_point_5 = ConstructPoint(XCoordinate=addition_5, YCoordinate=addition_5, ZCoordinate=python_script_2.i)
unit_y_5 = UnitY(Factor=y_3)
biarc = BiArc(StartPoint=construct_point_4, StartTangent=unit_x_4, EndPoint=construct_point_5, EndTangent=unit_x_4, Ratio=0.5)  # -> FirstArc, SecondArc, BiArc
mirror = Mirror(Geometry=biarc.BiArc, Plane=PlaneYZ(0, 0, 0))  # -> Geometry, Transform
extrude = Extrude(Base=[biarc.BiArc, mirror.Geometry], Direction=unit_y_5)
rotate_4 = Rotate(Geometry=extrude, Angle=degrees("90"), Plane=PlaneXY(0, 0, 0))  # -> Geometry, Transform
rotate_5 = Rotate(Geometry=rotate_4.Geometry, Angle=degrees("90"), Plane=PlaneXY(0, 0, 0))  # -> Geometry, Transform
rotate_6 = Rotate(Geometry=rotate_5.Geometry, Angle=degrees("90"), Plane=PlaneXY(0, 0, 0))  # -> Geometry, Transform
geometry_2 = Geometry([rotate_5.Geometry, extrude, rotate_4.Geometry, rotate_6.Geometry])

# ---- group: ファサード / n=1 / B1
negative_3 = Negative(Value=minimum)
multiplication_6 = Multiplication(A=minimum, B="2")
rectangle_4 = Rectangle(Plane=PlaneXY(0, 0, 0), XSize=multiplication_6, YSize=y_mm_幅, Radius=0)  # -> Rectangle, Length
unit_x_5 = UnitX(Factor=negative_3)
move_9 = Move(Geometry=rectangle_4.Rectangle, Motion=unit_x_5)  # -> Geometry, Transform
unit_y_6 = UnitY(Factor=addition_3)
move_10 = Move(Geometry=move_9.Geometry, Motion=unit_y_6)  # -> Geometry, Transform
boundary_surfaces_4 = BoundarySurfaces(Edges=move_10.Geometry)
rotate_7 = Rotate(Geometry=boundary_surfaces_4, Angle=degrees("90"), Plane=PlaneXY(0, 0, 0))  # -> Geometry, Transform
rotate_8 = Rotate(Geometry=rotate_7.Geometry, Angle=degrees("90"), Plane=PlaneXY(0, 0, 0))  # -> Geometry, Transform
rotate_9 = Rotate(Geometry=rotate_8.Geometry, Angle=degrees("90"), Plane=PlaneXY(0, 0, 0))  # -> Geometry, Transform

# ---- group: ファサード / n >= 2 / E
unit_y_7 = UnitY(Factor=y_2)
unit_x_6 = UnitX(Factor=1)
biarc_2 = BiArc(StartPoint=construct_point_3, StartTangent=unit_x_6, EndPoint=construct_point, EndTangent=unit_x_6, Ratio=0.5)  # -> FirstArc, SecondArc, BiArc
mirror_2 = Mirror(Geometry=biarc_2.BiArc, Plane=PlaneYZ(0, 0, 0))  # -> Geometry, Transform
extrude_2 = Extrude(Base=[biarc_2.BiArc, mirror_2.Geometry], Direction=unit_y_7)
rotate_10 = Rotate(Geometry=extrude_2, Angle=degrees("90"), Plane=PlaneXY(0, 0, 0))  # -> Geometry, Transform
rotate_11 = Rotate(Geometry=rotate_10.Geometry, Angle=degrees("90"), Plane=PlaneXY(0, 0, 0))  # -> Geometry, Transform
rotate_12 = Rotate(Geometry=rotate_11.Geometry, Angle=degrees("90"), Plane=PlaneXY(0, 0, 0))  # -> Geometry, Transform
geometry_3 = Geometry([extrude_2, rotate_10.Geometry, rotate_11.Geometry, rotate_12.Geometry])

# ---- group: ファサード / n >= 2 / C
unit_y_8 = UnitY(Factor=y_2)
unit_x_7 = UnitX(Factor=1)
biarc_3 = BiArc(StartPoint=move_6.Geometry, StartTangent=unit_x_7, EndPoint=construct_point_2, EndTangent=unit_x_7, Ratio=0.5)  # -> FirstArc, SecondArc, BiArc
mirror_3 = Mirror(Geometry=biarc_3.BiArc, Plane=PlaneYZ(0, 0, 0))  # -> Geometry, Transform
extrude_3 = Extrude(Base=[biarc_3.BiArc, mirror_3.Geometry], Direction=unit_y_8)
rotate_13 = Rotate(Geometry=extrude_3, Angle=degrees("90"), Plane=PlaneXY(0, 0, 0))  # -> Geometry, Transform
rotate_14 = Rotate(Geometry=rotate_13.Geometry, Angle=degrees("90"), Plane=PlaneXY(0, 0, 0))  # -> Geometry, Transform
rotate_15 = Rotate(Geometry=rotate_14.Geometry, Angle=degrees("90"), Plane=PlaneXY(0, 0, 0))  # -> Geometry, Transform

# ---- group: ファサード (continued)
move_11 = Move(
    Geometry=[solid_difference, boundary_surfaces_4, rotate_7.Geometry, rotate_8.Geometry, rotate_9.Geometry],
    Motion=unit_z_4)  # -> Geometry, Transform
geometry_4 = Geometry([extrude_3, rotate_13.Geometry, rotate_14.Geometry, rotate_15.Geometry])

# ---- group: 構造解析
x_mm = Number(x_mm_中心部_2x)
y_mm = Number(y_mm_幅)
min_z_x_y_mm = Number(minimum)
n_3 = Integer(number_slider)
t = Number(t_mm_厚さ)
division = Division(A=p_g_cm_2_平坦部密度, B="100000")
division_2 = Division(A=q_g_cm_2_湾曲部密度, B="100000")
division_3 = Division(A=x_mm, B="1")
division_4 = Division(A=y_mm, B="1")
division_5 = Division(A=min_z_x_y_mm, B="1")
p_kg_mm_2 = Number(division)
q_kg_mm_2 = Number(division_2)
x_mm_2 = Number(division_3)
y_mm_2 = Number(division_4)
min_z_x_y_mm_2 = Number(division_5)
b半分の質量_kg = Multiplication(A="2", B=p_kg_mm_2, C=y_mm_2, D=min_z_x_y_mm_2)
m_kg_bにかかる上部の質量 = GhPythonScript(x=x_mm_2, y=y_mm_2, z=min_z_x_y_mm_2, n=n_3, p=p_kg_mm_2, q=q_kg_mm_2)  # -> out, M
# ---------- m_kg_bにかかる上部の質量: Python ----------
__author__ = "taiga.u"

import rhinoscriptsyntax as rs

M = []

for num in range(n):
    num += 1
    m = p * y * (2*x + (4*num-3)*y + (4*num-4)*z) + 4*(num-1)*q*y*(x + (num-1)*y - z)
    M.append(m)
# ---------- end m_kg_bにかかる上部の質量 ----------
l_kg_m_b半分の質量 = Addition(A=m_kg_bにかかる上部の質量.M, B=b半分の質量_kg)
k_kg_fにかかる上部の質量 = GhPythonScript(x=x_mm_2, y=y_mm_2, z=min_z_x_y_mm_2, n=n_3, p=p_kg_mm_2, q=q_kg_mm_2)  # -> out, K
# ---------- k_kg_fにかかる上部の質量: Python ----------
__author__ = "taiga.u"

import rhinoscriptsyntax as rs

K = []

for num in range(n):
    num += 1
    k = p*y* (2*x + (4*num-3)*y + (4*num-6)*z) + 2*q*y* ((2*num-3) * (x-z) + (2*num*num - 6*num + 5)*y)
    K.append(k)
# ---------- end k_kg_fにかかる上部の質量 ----------
l_kg = Panel(l_kg_m_b半分の質量)
m_kg = Panel(m_kg_bにかかる上部の質量.M)
k_kg = Panel(k_kg_fにかかる上部の質量.K)
rmb_l = GhPythonScript(g=g_m_s_2_重力加速度, x=x_mm_2, y=y_mm_2, n=n_3)  # -> out, RMbL
# ---------- rmb_l: Python ----------
__author__ = "taiga.u"

import rhinoscriptsyntax as rs

RMbL = []

for num in range(n):
    num += 1
    rmbl = g * (x + (2*num-1)* y)
    RMbL.append(rmbl)
# ---------- end rmb_l ----------
rmf_k = GhPythonScript(g=g_m_s_2_重力加速度, x=x_mm_2, y=y_mm_2, z=min_z_x_y_mm_2, n=n_3)  # -> out, RMfK
# ---------- rmf_k: Python ----------
__author__ = "taiga.u"

import rhinoscriptsyntax as rs

RMfK = []

for num in range(n):
    num += 1
    rmfk = g * (x + (2*num -2) * y - z)
    RMfK.append(rmfk)
# ---------- end rmf_k ----------
division_6 = Division(A=y_mm_2, B="2")
rmb = Multiplication(A=l_kg_m_b半分の質量, RMbL=rmb_l.RMbL)
rmc = GhPythonScript(x=x_mm_2, y=y_mm_2, z=min_z_x_y_mm_2, n=n_3, q=q_kg_mm_2)  # -> out, RMc
# ---------- rmc: Python ----------
__author__ = "taiga.u"

import rhinoscriptsyntax as rs

RMc = []

for num in range(n):
    num += 1
    rmc = (x + (2*num-1)*y - z)/2 * q * y * (x + (2*num-1)*y -z)
    RMc.append(rmc)
# ---------- end rmc ----------
rmf = Multiplication(A=k_kg_fにかかる上部の質量.K, RMfK=rmf_k.RMfK)
rme = GhPythonScript(x=x_mm_2, y=y_mm_2, z=min_z_x_y_mm_2, n=n_3, q=q_kg_mm_2)  # -> out, RMe
# ---------- rme: Python ----------
__author__ = "taiga.u"

import rhinoscriptsyntax as rs

RMe = []

for num in range(n):
    num += 1
    rme = (x + (2*num-3)*y - z)/2 * q * y * (x + (2*num-3)*y - z)
    RMe.append(rme)
# ---------- end rme ----------
rmbb_n_mm = Multiplication(A=m_kg_bにかかる上部の質量.M, B=g_m_s_2_重力加速度, Y2=division_6)
zb_断面係数 = GhPythonScript(b=min_z_x_y_mm_2, h=t)  # -> out, Z
# ---------- zb_断面係数: Python ----------
__author__ = "taiga.u"

import rhinoscriptsyntax as rs

Z = b * h * h / 6
# ---------- end zb_断面係数 ----------
zy_断面係数 = GhPythonScript(b=y_mm_2, h=t)  # -> out, Z; same code as zb_断面係数
rmbc_n_mm = Multiplication(A=l_kg_m_b半分の質量, B=g_m_s_2_重力加速度, C=min_z_x_y_mm_2)
rmfe_n_mm = Multiplication(A=k_kg_fにかかる上部の質量.K, B=g_m_s_2_重力加速度, C=y_mm_2)
rmcd_n_mm = Addition(RMb=rmb, RMc=rmc.RMc)
rmeb_n_mm = Addition(RMf=rmf, RMe=rme.RMe)
zb_mm_3 = Panel(zb_断面係数.Z)
rmbb_n_mm_2 = Panel(rmbb_n_mm)
rmbc_n_mm_2 = Panel(rmbc_n_mm)
rmfe_n_mm_2 = Panel(rmfe_n_mm)
zy_mm_3 = Panel(zy_断面係数.Z)
rmcd_n_mm_2 = Panel(rmcd_n_mm)
rmeb_n_mm_2 = Panel(rmeb_n_mm)
σbb_曲げ応力度 = Division(RMbb=rmbb_n_mm, Zb=zb_断面係数.Z)
σcd = Division(RM=rmcd_n_mm, B=zy_断面係数.Z)
σfe = Division(RM=rmfe_n_mm, B=zy_断面係数.Z)
σbc = Division(RM=rmbc_n_mm, B=zy_断面係数.Z)
σeb = Division(RM=rmeb_n_mm, B=zy_断面係数.Z)
σbb_n_mm_2 = Panel(σbb_曲げ応力度)
σcd_n_mm_2 = Panel(σcd)
σbc_n_mm_2 = Panel(σbc)
σeb_n_mm_2 = Panel(σeb)
σfe_n_mm_2 = Panel(σfe)
bnd = Bounds(Numbers=σbb_曲げ応力度)
bnd_2 = Bounds(Numbers=σcd)
bnd_3 = Bounds(Numbers=σbc)
bnd_4 = Bounds(Numbers=σeb)
bnd_5 = Bounds(Numbers=σfe)
dedomain = DeconstructDomain(Domain=bnd)  # -> Start, End
dedomain_2 = DeconstructDomain(Domain=bnd_2)  # -> Start, End
dedomain_3 = DeconstructDomain(Domain=bnd_3)  # -> Start, End
dedomain_4 = DeconstructDomain(Domain=bnd_4)  # -> Start, End
dedomain_5 = DeconstructDomain(Domain=bnd_5)  # -> Start, End
σb最大値 = Panel(dedomain.End)
σcd最大値 = Panel(dedomain_2.End)
σbc最大値 = Panel(dedomain_3.End)
σeb最大値 = Panel(dedomain_4.End)
σfe最大値 = Panel(dedomain_5.End)

# ---- group: ファサード / Extrude (continued)
extrude_4 = Extrude(Base=[geometry_2, geometry_4], Direction=unit_z_2)
extrude_5 = Extrude(Base=geometry_3, Direction=unit_z)
dispatch = Dispatch(List=extrude_5, DispatchPattern=color_mono)  # -> ListA, ListB
dispatch_2 = Dispatch(List=extrude_4, DispatchPattern=color_mono)  # -> ListA, ListB
custom_preview = CustomPreview(Geometry=dispatch_2.ListA, Shader=ColourSwatch(SwatchColor=RGB(251, 208, 29)))
custom_preview_2 = CustomPreview(Geometry=dispatch.ListA, Shader=ColourSwatch(SwatchColor=RGB(237, 38, 38)))

# ---- group: ファサード / n >= 2 / B
multiplication_7 = Multiplication(A=min_z_x_y, B="2")
multiplication_8 = Multiplication(A="2", B=y)
rectangle_5 = Rectangle(Plane=PlaneXY(0, 0, 0), XSize=multiplication_7, YSize=multiplication_8, Radius=0)  # -> Rectangle, Length
boundary_surfaces_5 = BoundarySurfaces(Edges=rectangle_5.Rectangle)
negative_4 = Negative(Value=multiplication_7)
construct_point_6 = ConstructPoint(XCoordinate="0", YCoordinate="0", ZCoordinate=0)
unit_x_8 = UnitX(Factor=negative_4)
vector_2pt = Vector2Pt(PointA=construct_point_6, PointB=construct_point_3, Unitize=False)  # -> Vector, Length
move_12 = Move(Geometry=boundary_surfaces_5, Motion=vector_2pt.Vector)  # -> Geometry, Transform
move_13 = Move(Geometry=move_12.Geometry, Motion=unit_x_8)  # -> Geometry, Transform

# ---- group: ファサード / n >= 2 / D
rectangle_6 = Rectangle(Plane=PlaneXY(0, 0, 0), XSize=y, YSize=y, Radius=0)  # -> Rectangle, Length
boundary_surfaces_6 = BoundarySurfaces(Edges=rectangle_6.Rectangle)
vector_2pt_2 = Vector2Pt(PointA=construct_point_6, PointB=construct_point_2, Unitize=False)  # -> Vector, Length
move_14 = Move(Geometry=boundary_surfaces_6, Motion=vector_2pt_2.Vector)  # -> Geometry, Transform

# ---- group: ファサード / n >= 2 / F
rectangle_7 = Rectangle(Plane=PlaneXY(0, 0, 0), XSize=multiplication_8, YSize=multiplication_8, Radius=0)  # -> Rectangle, Length
boundary_surfaces_7 = BoundarySurfaces(Edges=rectangle_7.Rectangle)
vector_2pt_3 = Vector2Pt(PointA=construct_point_6, PointB=construct_point, Unitize=False)  # -> Vector, Length
move_15 = Move(Geometry=boundary_surfaces_7, Motion=vector_2pt_3.Vector)  # -> Geometry, Transform
negative_5 = Negative(Value=y)
unit_y_9 = UnitY(Factor=negative_5)
move_16 = Move(Geometry=move_15.Geometry, Motion=unit_y_9)  # -> Geometry, Transform

# ---- group: ファサード / n >= 2 / B (continued)
rotate_16 = Rotate(Geometry=[move_13.Geometry, move_14.Geometry, move_16.Geometry], Angle=degrees("90"), Plane=PlaneXY(0, 0, 0))  # -> Geometry, Transform
rotate_17 = Rotate(Geometry=rotate_16.Geometry, Angle=degrees("90"), Plane=PlaneXY(0, 0, 0))  # -> Geometry, Transform
rotate_18 = Rotate(Geometry=rotate_17.Geometry, Angle=degrees("90"), Plane=PlaneXY(0, 0, 0))  # -> Geometry, Transform
geometry_5 = Geometry([move_13.Geometry, rotate_16.Geometry, rotate_17.Geometry, rotate_18.Geometry, move_14.Geometry, move_16.Geometry])

# ---- group: ファサード / Extrude (continued)
extrude_6 = Extrude(Base=[move_11.Geometry, geometry, geometry_5], Direction=unit_z_3)
dispatch_3 = Dispatch(List=extrude_6, DispatchPattern=color_mono)  # -> ListA, ListB
custom_preview_3 = CustomPreview(Geometry=dispatch_3.ListA, Shader=ColourSwatch(SwatchColor=RGB(69, 148, 222)))
custom_preview_4 = CustomPreview(Geometry=[dispatch.ListB, dispatch_2.ListB, dispatch_3.ListB], Shader=ColourSwatch(SwatchColor=RGB(255, 230, 230)))

# ---- group: 光環境解析6-4.ver / 解析対象
radopaquematerial = Honeybee_RadianceOpaqueMaterial(
    materialName=ファサードマテリアル,
    RReflectance=ファサード反射率,
    GReflectance=ファサード反射率,
    BReflectance=ファサード反射率,
    roughness=0.05,
    specularity=0)  # -> avrgRef, RADMaterial; plug-in component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
radglassmaterial = Honeybee_RadianceGlassMaterial(materialName=ガラスマテリアル, RTransmittance=ガラス透過率, GTransmittance=ガラス透過率, BTransmittance=ガラス透過率, refractiveIndex=1.52)  # -> avrgTrans, RADMaterial; plug-in component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
ファサード枠 = ファサード枠(A=multiplication, B=y_mm_幅, C=number_slider)
ファサード_下面 = Geometry([move_11.Geometry, geometry_2, geometry, geometry_5, geometry_4, geometry_3])
sdiff = SolidDifference(BrepsA=天井, BrepsB=ファサード枠)
createhbsrfs = Honeybee_createHBSrfs(geometry=壁, srfType="0")  # -> readMe, simplify(HBSurface); plug-in component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
createhbsrfs_2 = Honeybee_createHBSrfs(geometry=sdiff, srfType="3")  # -> readMe, simplify(HBSurface); plug-in component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
createhbsrfs_3 = Honeybee_createHBSrfs(geometry=床, srfType="2")  # -> readMe, simplify(HBSurface); plug-in component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
createhbsrfs_4 = Honeybee_createHBSrfs(geometry=家具)  # -> readMe, simplify(HBSurface); plug-in component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
createhbsrfs_5 = Honeybee_createHBSrfs(geometry=ファサード_下面, RADMaterial=radopaquematerial.RADMaterial)  # -> readMe, simplify(HBSurface); plug-in component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
createhbsrfs_6 = Honeybee_createHBSrfs(geometry=[ガラス, ファサード枠], RADMaterial=radglassmaterial.RADMaterial)  # -> readMe, simplify(HBSurface); plug-in component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
全サーフェス = Brep(flatten([createhbsrfs.HBSurface, createhbsrfs_2.HBSurface, createhbsrfs_3.HBSurface, createhbsrfs_4.HBSurface, createhbsrfs_6.HBSurface, createhbsrfs_5.HBSurface]))
wires = BrepWireframe(Brep=全サーフェス, Density=-1)

# ---- group: 光環境解析6-4.ver / 解析開始
doy_hoy = Ladybug_DOY_HOY(days=日, months=月, hours=時)  # -> HOY, DOY, date; plug-in component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
rundaylightanalysis = Honeybee_RunDaylightSimulation(
    HBObjects=flatten(全サーフェス),
    analysisRecipe=imagebasedsimulation,
    writeRad=結果書き込み,
    runRad=解析開始,
    workingDir=作業フォルダ,
    radFileName=doy_hoy.date,
    overwriteResults=True)  # -> readMe, analysisType, resultsUnit, results, testPts, resultFiles, radGeoFile, studyFolder, done; plug-in component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

# ---- group: 光環境解析6-4.ver / 解析結果表示
glareanalysis = Honeybee_GlareAnalysis(HDRImagePath=rundaylightanalysis.resultFiles, runIt=Toggle(True))  # -> readMe, glareCheckImage, DGP, DGI, glareComfortRange, imageWithTaskArea; plug-in component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
falsecolor = Honeybee_FalseColor(
    HDRFilePath=rundaylightanalysis.resultFiles,
    contourBands=False,
    maskThreshold=0.1,
    useAlterColors=False,
    render=Toggle(True))  # -> outputFilePath; plug-in component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
hdr_gif = Honeybee_ConvertHDRToGIF(HDRFilePath=falsecolor, adjustExposure=False)  # -> GIFFilePath; plug-in component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
hdr_gif_2 = Honeybee_ConvertHDRToGIF(HDRFilePath=glareanalysis.glareCheckImage, adjustExposure=Toggle(True))  # -> GIFFilePath; plug-in component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
グレア評価_dgp = Panel(glareanalysis.DGP)

# ---- group: 光環境解析6-4.ver / 解析結果表示 / グレア評価画像表示
viewer = Ladybug_ImageViewer(ImagePath_=hdr_gif_2, _scale_=1, DisableClickable=False, SaveImgWithCoords=False, scale=1)  # -> ImagePath, Colors, GIF

# ---- group: 光環境解析6-4.ver / 解析結果表示 / 輝度画像表示
viewer_2 = Ladybug_ImageViewer(ImagePath_=hdr_gif, _scale_=1, DisableClickable=False, SaveImgWithCoords=False, scale=1)  # -> ImagePath, Colors, GIF

# ---- group: 光環境解析6-4.ver / マネキン設置 / 視線設定
マネキン位置設定 = Point(Point(0, 0, -2200))
視線角度設定 = Panel("175")
comfortmannequin = Ladybug_ComfortMannequin(rotationAngle=視線角度設定, bodyLocation=マネキン位置設定)  # -> mannequinMesh, legend, legendBasePt; plug-in component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

# ---- group: 光環境解析6-4.ver / マネキン設置 / 視線設定 / マネキンの顔部分
item = ListItem(List=comfortmannequin.mannequinMesh, Index=121, Wrap=True)

# ---- group: 光環境解析6-4.ver / マネキン設置 / 視線設定 (continued)
preview = CustomPreview(Geometry=item, Shader=ColourSwatch(SwatchColor=RGB(246, 177, 162)))

# ---- group: 光環境解析6-4.ver / マネキン設置
facen = FaceNormals(Mesh=item)  # -> Centers, Normals
md_slider = MDSlider(
    SliderMode=0,
    slider_value=Point(0.5114254835, 0.5048522949, 0.5),
    x_domain=Domain(-1, 1),
    y_domain=Domain(-1, 1),
    z_domain=Domain(0, 1))
settheview = Ladybug_SetTheView(cameraLocation=facen.Centers, cameraDirection=facen.Normals, uvLookAround=md_slider)  # plug-in component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

# ==== cluster ファサード枠
B = ClusterInput()
C = ClusterInput()
A = ClusterInput()
multiplication = Multiplication(A="4", B=B, C=C)
addition = Addition(A=A, B=multiplication)
rectangle = Rectangle(Plane=PlaneXY(0, 0, 0), XSize=addition, YSize=addition, Radius=0)  # -> Rectangle, Length
division = Division(A=addition, B="-2")
X = UnitX(Factor=division)
move = Move(Geometry=rectangle.Rectangle, Motion=X)  # -> Geometry, Transform
Y = UnitY(Factor=division)
move_2 = Move(Geometry=move.Geometry, Motion=Y)  # -> Geometry, Transform
boundary = BoundarySurfaces(Edges=move_2.Geometry)
S = ClusterOutput(boundary)
